# Grasshopper definition Egg Shell - Homework.gh (Grasshopper 1.0.7)
# plug-ins: NGon

egg_xy_0_00_to_2_00 = GetNumber(Slider(0, range=0..2), AtLeast=1, AtMost=1, Maximum=1.797693135e+308, Minimum=-1.797693135e+308, TreeAccess=False)
egg_z_1_40_to_1_30 = GetNumber(
    Slider(1.3, range=-1.42..1.3),
    AtLeast=1,
    AtMost=1,
    Maximum=1.797693135e+308,
    Minimum=-1.797693135e+308,
    TreeAccess=False)
width_y = Slider(8.99, range=0..50)
depth_x = Slider(9.66, range=0..50)
height_z = Slider(15.47, range=0..50)
u_subdivisions = Slider(5, range=0..50)
pi = Pi(Factor="2")
pi_2 = Pi(Factor=egg_xy_0_00_to_2_00)
v_subdivisions = Slider(12, range=0..50)
construct_domain = ConstructDomain(DomainStart=egg_z_1_40_to_1_30, DomainEnd=Slider(-1.42, range=-1.42..1.2))
construct_domain_2 = ConstructDomain(DomainStart=pi_2, DomainEnd=pi)
panel = Panel("""a*cos(u)*cos(v)
b*sin(u)*cos(v)
c*sin(v)""")
e_height = GetNumber(height_z, AtLeast=1, AtMost=1, Maximum=1.797693135e+308, Minimum=-1.797693135e+308, TreeAccess=False)
e_width = GetNumber(width_y, AtLeast=1, AtMost=1, Maximum=1.797693135e+308, Minimum=-1.797693135e+308, TreeAccess=False)
e_depth = GetNumber(depth_x, AtLeast=1, AtMost=1, Maximum=1.797693135e+308, Minimum=-1.797693135e+308, TreeAccess=False)
range = Range(Domain=construct_domain, Steps=u_subdivisions)
range_2 = Range(Domain=construct_domain_2, Steps=v_subdivisions)
cross_reference = CrossReference(ListListA=range, ListListB=range_2, CrossMode=1)  # -> ListListA, ListListB
evaluate = Evaluate(Expression=graft(panel), a=e_width, b=e_depth, c=e_height, v=cross_reference.ListListA, u=cross_reference.ListListB)
explode_tree = ExplodeTree(Data=evaluate)  # -> Branch0, Branch1, Branch2
param_viewer = ParamViewer(evaluate)
construct_point = ConstructPoint(XCoordinate=explode_tree.Branch0, YCoordinate=explode_tree.Branch1, ZCoordinate=explode_tree.Branch2)
surface_from_points = SurfaceFromPoints(Points=construct_point, UCount=expr("X+1", v_subdivisions), Interpolate=invert(False))
surface = Surface(surface_from_points)
uc_surface = GetInteger(Slider(45, range=0..100), AtLeast=1, AtMost=1, Maximum=2147483647, Minimum=-2147483648, TreeAccess=False)
vc_surface = GetInteger(Slider(32, range=0..100), AtLeast=1, AtMost=1, Maximum=2147483647, Minimum=-2147483648, TreeAccess=False)
divide_surface = DivideSurface(Surface=surface, UCount=uc_surface, VCount=vc_surface)  # -> Points, Normals, Parameters
point = Point(divide_surface.Points)
nurbs_curve = NurbsCurve(Vertices=point, Degree=3, Periodic=False)  # -> Curve, Length, Domain
divide_curve = DivideCurve(Curve=nurbs_curve.Curve, Count=Slider(8, range=0..10), Kinks=Slider(5, range=0..10))  # -> simplify(Points), Tangents, Parameters
point_2 = Point(divide_curve.Points)
flip = FlipMatrix(Data=point_2)
relative_item = RelativeItem(Tree=divide_curve.Points, Offset="{1},(1)", WrapPaths=False, WrapItems=False)  # -> flatten(ItemA), flatten(ItemB)
nurbs_curve_2 = NurbsCurve(Vertices=flip, Degree=3, Periodic=False)  # -> Curve, Length, Domain
line = Line(StartPoint=relative_item.ItemA, EndPoint=relative_item.ItemB)
point_3 = Point(relative_item.ItemB)
number_slider = Slider(1, range=0..1)
curveshatter = CurveShatter(Curve=line, Points=relative_item.ItemA, Tolerance=0.01)  # -> flatten(Curves)
pipe_1 = GetNumber(number_slider, AtLeast=1, AtMost=1, Maximum=1, Minimum=-1.797693135e+308, TreeAccess=False)
pipe_2 = GetNumber(number_slider, AtLeast=1, AtMost=1, Maximum=1, Minimum=-1.797693135e+308, TreeAccess=False)
pipe = Pipe(Curve=curveshatter, Radius=pipe_1, Caps=0)  # -> flatten(Pipe)
pipe_3 = Pipe(Curve=nurbs_curve_2.Curve, Radius=pipe_2, Caps=0)  # -> flatten(Pipe)
context_bake = ContextBake(Geometry=[pipe, pipe_3])
