# Grasshopper definition Recursive_curve_hops_yichen.gh (Grasshopper 1.0.7)
# plug-ins: Yellow

db = Slider(5.005, range=0..10)
nb = Slider(7, range=0..100)
na = Slider(10, range=0..100)
z = Slider(66, range=0..100)
dev = Slider(45.9, range=0..100)
da = Slider(5.892, range=0..10)
nc = Slider(11, range=0..100)
num_curves = Slider(17, range=0..100)
V = Slider(4.9, range=0..10)
bottom_grid_distance_da = GetNumber(da, AtLeast=1, AtMost=1, Maximum=1.797693135e+308, Minimum=-1.797693135e+308, TreeAccess=False)
bottom_grid_na = GetInteger(na, AtLeast=1, AtMost=1, Maximum=2147483647, Minimum=-2147483648, TreeAccess=False)
top_grid_distance_db = GetNumber(db, AtLeast=1, AtMost=1, Maximum=1.797693135e+308, Minimum=-1.797693135e+308, TreeAccess=False)
top_grid_nb = GetInteger(nb, AtLeast=1, AtMost=1, Maximum=2147483647, Minimum=-2147483648, TreeAccess=False)
curve_dev = GetNumber(dev, AtLeast=1, AtMost=1, Maximum=1.797693135e+308, Minimum=-1.797693135e+308, TreeAccess=False)
hight = GetInteger(z, AtLeast=1, AtMost=1, Maximum=2147483647, Minimum=-2147483648, TreeAccess=False)
curve_v = GetNumber(V, AtLeast=1, AtMost=1, Maximum=1.797693135e+308, Minimum=-1.797693135e+308, TreeAccess=False)
connections_nc = GetInteger(nc, AtLeast=1, AtMost=1, Maximum=2147483647, Minimum=-2147483648, TreeAccess=False)
vertical_connections_nc = GetInteger(num_curves, AtLeast=1, AtMost=1, Maximum=2147483647, Minimum=-2147483648, TreeAccess=False)
python = GhPythonScript(
    na=bottom_grid_na,
    da=bottom_grid_distance_da,
    nb=top_grid_nb,
    db=top_grid_distance_db,
    z=hight,
    dev=curve_dev,
    V=curve_v,
    nc=connections_nc,
    num_curves=vertical_connections_nc)  # -> out, GridA, GridB, Lines, Curves; inputs na: Int32, nb: Int32, db: Int32, nc: Int32, num_curves: Int32
# ---------- python: Python ----------
import rhinoscriptsyntax as rs
import random 




def PtGrid(num, step, h):
    List = []
    for x in range(0, num):
        for y in range(0, num):
            List.append(rs.AddPoint([x*step, y*step, h]))
    return List
    
def GetRndPtOnCurve(curve, cond):
    if(cond):
        r = random.uniform(0,0.35)
    else:
        r = random.uniform(0.65,1)
    dom = rs.CurveDomain(curve)
    return rs.CurvePerpFrame(curve, dom[1]*random.random())
    #return rs.EvaluateCurve(curve, dom[1]*random.random())

random.seed(0)
GridA = PtGrid(na, da, 0)
GridB = PtGrid(nb, db, z)


    
count = 0
Lines= []
Curves = []
while(True):
    #do something
    A = random.choice(GridA)
    B = random.choice(GridB)
    #Lines.append(rs.AddLine(A, B))
    
    A2 = rs.PointAdd(A, [0,0,dev])
    B2 = rs.PointAdd(B, [0,0,-dev])
    c = rs.AddCurve([A,A2,B2,B])
    Lines.append(c)
    Curves.append(c)
    count = count+1
    if(count > num_curves):
        break

count = 0
while(True):
    #choose a random curve
    A = random.choice(Lines)
    Lines.remove(A)
    #get a random point point on that curve
    ptA = GetRndPtOnCurve(A, True)
    
    
    #choose a random curve
    B = random.choice(Lines)
    #get a random point point on that curve
    ptB = GetRndPtOnCurve(B, False)
    #L=rs.AddLine(ptA.Origin,ptB.Origin)
    
    A2= rs.PointAdd(ptA.Origin, rs.VectorScale(ptA.ZAxis, V))
    B2= rs.PointAdd(ptB.Origin, rs.VectorScale(ptB.ZAxis, -V))
    
    L=rs.AddCurve([ptA.Origin,A2,B2,ptB.Origin])
    
    Lines.append(L)
    Curves.append(L)
    count = count+1

    if(count > nc):
        break
# ---------- end python ----------
pipe_radius = GetNumber(Slider(0.604, range=0..10), AtLeast=1, AtMost=1, Maximum=1.797693135e+308, Minimum=-1.797693135e+308, TreeAccess=False)
crv = Curve(python.Curves)
crv_2 = Curve(python.Lines)
number_slider = Slider(64, range=0..100)
mesh_pipe = MeshPipe(Curve=[crv_2, crv], Radius=pipe_radius, Segments=number_slider, Accuracy=number_slider, CapType=0, Faceted=False)
point = Point([python.GridA, python.GridB])
context_bake = ContextBake(Geometry=[mesh_pipe, point])
