# Grasshopper definition hops_WillNash.gh (Grasshopper 1.0.7)
# plug-ins: Weaverbird

max_vertices = GetInteger(
    Slider(1000, range=10..1000),
    AtLeast=1,
    AtMost=1,
    Maximum=2147483647,
    Minimum=-2147483648,
    Prompt="Set the max. vertices [int: 10 : 1000]",
    TreeAccess=False)
reset = GetBoolean(Button(), AtLeast=1, AtMost=1, FalseValue="False", Prompt="button to reset", TreeAccess=False, TrueValue="True")
grow = GetBoolean(
    Toggle(True),
    AtLeast=1,
    AtMost=1,
    FalseValue="False",
    Prompt="Toggle whether to grow or not",
    TreeAccess=False,
    TrueValue="True")
select = GetInteger(
    Slider(0, range=0..2),
    AtLeast=1,
    AtMost=1,
    Maximum=2147483647,
    Minimum=-2147483648,
    Prompt="select a starting mesh: 0 = hyperbolic paraboloid, 1 = enneper surface, 2 = toroid",
    TreeAccess=False)
resolution = GetNumber(
    Slider(5, range=0.5..10),
    AtLeast=1,
    AtMost=1,
    Maximum=1.797693135e+308,
    Minimum=-1.797693135e+308,
    Prompt="Set the resolution [double: 0.5 : 10.0]",
    TreeAccess=False)
enneper = Mesh(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)
hyperparaboloid = Mesh(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)
torus = Mesh(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)
merge = Merge(Data1=hyperparaboloid, Data2=enneper, Data3=torus)
list_item = ListItem(List=merge, Index=select, Wrap=True)
iterations = GetInteger(Slider(80, range=0..100), AtLeast=1, AtMost=1, Maximum=2147483647, Minimum=-2147483648, TreeAccess=False)
c_script = CSharpScript(
    reset=reset,
    msh=list_item,
    grow=grow,
    maxVerts=max_vertices,
    edgeLengthWeight=Slider(0.5, range=0..1),
    radius=resolution,
    collisionWeight=Slider(0.5, range=0..1),
    iterCount=Slider(3, range=0..10),
    bendingResistance=Slider(0.2, range=0..1),
    iterations=iterations,
    Reference="C:\Users\cawn069856\gits\HelloGrasshopper\HelloGrasshopper\MyGrasshopperAssembly1\bin\Debug\net48\Armadillo.gha")  # -> out, mshOut; inputs reset: Boolean, msh: Mesh, grow: Boolean, maxVerts: Int32, edgeLengthWeight: Double, radius: Double, collisionWeight: Double, iterCount: Int32, bendingResistance: Double, iterations: Int32
# ---------- c_script: C# usings ----------
using Armadillo;
# ---------- c_script: C# ----------
    if (reset || system == null)
    {
      system = new MeshGrowthSystem(msh);
    }

    system.Grow = grow;
    system.MaxVertexCount = maxVerts;
    system.CollisionDistance = radius;
    system.UseRTree = true;
    system.EdgeLengthConstraintWeight = edgeLengthWeight;
    system.CollisionWeight = collisionWeight;
    system.BendingResistanceWeight = bendingResistance;

    for (int iter = 0; iter < iterations; iter++)
    {
      for (int i = 0; i < iterCount; i++)
      {
        system.Update();

      }
      mshOut = system.GetRhinoMesh();
    }
    mshOut = system.GetRhinoMesh();
# ---------- c_script: C# additional code ----------
  private MeshGrowthSystem system;
# ---------- end c_script ----------
mesh = Mesh(c_script.mshOut)
weaverbird_s_catmull_clark_subdivision = WeaverbirdsCatmullClarkSubdivision(MeshCurves=mesh, Level=Slider(2, range=0..10), SmoothNakedEdges=1)
context_bake = ContextBake(SeaweedMesh=weaverbird_s_catmull_clark_subdivision)
