# Grasshopper definition Wrinkly Cylinder_zombie solver.gh (Grasshopper 1.0.7)
# plug-ins: Kangaroo2 Components, Weaverbird

keepongeometry = Slider(0.442, range=0..10)
surface_increase = Slider(1.592, range=1..10)
smoothing = Slider(3.726, range=0..20)
smoothing_2 = GetNumber(smoothing, AtLeast=1, AtMost=1, Maximum=1.797693135e+308, Minimum=-1.797693135e+308, TreeAccess=False)
geometry_deviation = GetNumber(keepongeometry, AtLeast=1, AtMost=1, Maximum=1.797693135e+308, Minimum=-1.797693135e+308, TreeAccess=False)
surface_increase_2 = GetNumber(surface_increase, AtLeast=1, AtMost=1, Maximum=1.797693135e+308, Minimum=-1.797693135e+308, TreeAccess=False)
R = Radius(12)
pt = Point(Point(0, 0, 0))
mesh_resolution = Panel("0.5")
cylinder = Cylinder(Base=pt, Radius=R, Length=R)
addition = Addition(A=mesh_resolution, B=mesh_resolution)
triremesh = TriRemesh(Geometry=cylinder, Length=addition, Iterations=25)  # -> Triangulation, Dual, Creases
nakedvertices = NakedVertices(Mesh=triremesh.Triangulation)  # -> ClothedIndex, NakedIndex, ClothedPts, NakedPts
demesh = DeconstructMesh(Mesh=triremesh.Triangulation)  # -> Vertices, Faces, Colours, Normals
multiplication = Multiplication(A=mesh_resolution, B=surface_increase_2)
data = Data(nakedvertices.NakedPts)
ln = Line(StartPoint=pt, EndPoint=demesh.Vertices)
edgelengths = EdgeLengths(Mesh=triremesh.Triangulation, LengthFactor=surface_increase_2, Strength=0.1)
sc = SphereCollide(Points=demesh.Vertices, Radius=multiplication, Strength=10)
volume = Volume(Mesh=triremesh.Triangulation, Strength=0.01)
anchor = Anchor(Point=data, Strength=10000)
length_line = LengthLine(Line=ln, Length=R, Strength=geometry_deviation)
smooth = Smooth(M=triremesh.Triangulation, Strength=smoothing_2)
show = Show(G=triremesh.Triangulation)
entwine = Entwine(Branch00=show, Branch01=[smooth, sc, volume, edgelengths, length_line, anchor], FlattenInputs=True)
zombiesolver = ZombieSolver(GoalObjects=entwine, Threshold=1e-10, Tolerance=0.0001, MaxIterations=Slider(100, range=0..100))  # -> I, V, O
bang = ExplodeTree(Data=zombiesolver.O)  # -> Branch0, Branch1
wbloop = WeaverbirdsLoopSubdivision(MeshCurves=bang.Branch0, Level=2, SmoothNakedEdges=1)
context_bake = ContextBake(Geometry=wbloop)
preview = CustomPreview(
    Geometry=wbloop,
    Material={diffuse=RGB(63, 191, 127), emission=RGB(0, 0, 0), shine=0.85, specular=RGB(217, 217, 217), transparency=0})
